# Dynamo graph MoveToOrigin.dyn "moveToOrigin_extended" (Dynamo 2.0.3.8810)

# group: Select elements
code_block = CodeBlock()
# ---------- code_block.designscript (5 lines) ----------
// Category type elements
["Model",
"Annotation"];
"AnalyticalModel";
"Internal";
# ----------------------------------------
elementByCategoryType = Orchid.RevitProject.Elements.Selection.ElementByCategoryType(categoryType=code_block.out0)
clean = Orchid.Core.List.Clean(list=elementByCategoryType.Element)

# group: Select special elements
element_types = ElementTypes(index=210)
all_elements_of_type = ElementsOfType(element_type=element_types)
allStackedWall = Orchid.RevitProject.Elements.Wall.AllStackedWall()
allModel = Orchid.RevitProject.Elements.Group.AllModel()
getSeparationLine = Orchid.RevitProject.Elements.SpatialElement.GetSeparationLine()
list_create = List.Create(item0=all_elements_of_type, item1=allStackedWall, item2=allModel, item3=getSeparationLine.Element)

# group: join selection
join = List.Join(list0=clean, list1=list_create)
flatten = List.Flatten(list=join)

# group: new origin -> as vector
select_model_element = DSModelElementSelection()  # 1 picked in the model
getLocation = Element.GetLocation(element=select_model_element)
asVector = Point.AsVector(point=getLocation)
reverse = Vector.Reverse(vector=asVector)

# group: Adjust model
code_block_2 = CodeBlock { "dummy"; }
create = Orchid.RevitProject.Elements.Group.Create(name=code_block_2, element=flatten)
allDetail = Orchid.RevitProject.Elements.Group.AllDetail()
join_2 = List.Join(list0=create, list1=allDetail)
start = Revit.Transaction.Transaction.Start(input=join_2)
moveByVector = Element.MoveByVector(element=start, vector=reverse)
end = Revit.Transaction.Transaction.End(input=moveByVector)
await_ = Orchid.Core.DataStream.Await(pass=code_block_2, waitFor=end)
unGroup = Orchid.RevitProject.Elements.Group.UnGroup(name=await_)
await_2 = Orchid.Core.DataStream.Await(pass=await_, waitFor=unGroup)
delete = Orchid.RevitProject.Elements.GroupType.Delete(name=await_2)

# group: Adjust view crop box
modelAll = Orchid.RevitProject.Views.View.ModelAll()
move = Orchid.RevitProject.Views.View.Move(view=modelAll, vector=reverse)

# group: Adjust sectionsbox
view_type = ViewType(index=0)
allByType = Orchid.RevitProject.Views.View.AllByType(viewType=view_type)
moveSectionBox = Orchid.RevitProject.Views.View.MoveSectionBox(view3D=allByType, vector=reverse)
